# Grasshopper definition SpeckleCore.Hacks.gh (Grasshopper 0.9.76)
# plug-ins: SpeckleGrasshopper

client_factory = CSharpScript(
    BaseUrl="https://s003.speckle.works/api",
    Reference=["C:\Users\Dim\AppData\Roaming\Grasshopper\Libraries\SpeckleSendReceive\SpeckleCore.dll", "C:\Users\Dim\AppData\Roaming\Grasshopper\Libraries\SpeckleSendReceive\SpeckleRhinoConverter.dll"])  # -> Client; inputs BaseUrl: String
# ---------- client_factory: C# ----------
    if(myClient == null || BaseUrl != myClient.BaseUrl ) {
      myClient = new BaseSpeckleApiClient();
      myClient.BaseUrl = BaseUrl;
    }

    Client = myClient;
# ---------- client_factory: C# additional code ----------
  BaseSpeckleApiClient myClient = null;
# ---------- end client_factory ----------

# ---- group: LoginAsync - 2
loginasync = CSharpScript(
    Client=client_factory,
    Email="johndoe2@apple.com",
    Password="hello",
    Reference="C:\Users\Dim\AppData\Roaming\Grasshopper\Libraries\SpeckleSendReceive\SpeckleCore.dll")  # -> Response, ClientOut; inputs Email: String, Password: String
# ---------- loginasync: C# ----------
    BaseSpeckleApiClient myClient = Client as BaseSpeckleApiClient;

    // Output stuff first, as we might return from the actual method and not get to the bottom
    Response = myResponse;

    // If the response is not null, set the AuthToken value of the client and output it as well
    if(myResponse != null) myClient.AuthToken = myResponse.ApiToken;
    ClientOut = myClient;

    // check if we really need to invoke a new login:
    // 1) Are the inputs there?
    // 2) Are the inputs different than the last ones?
    if((Email != null && Password != null && myClient != null) && (_Email != Email || _Password != Password))
    {
      // Store the inputs so we can compare new vs. old
      _Email = Email; _Password = Password;

      // Invoke the method from outside the main thread
      Rhino.RhinoApp.MainApplicationWindow.Invoke(new Action(() =>
        {
        // store the response
        myResponse = myClient.UserLogin(new PayloadAccountLogin() { Email = Email, Password = Password });
        // trigger a component refresh
        this.Component.ExpireSolution(true);
        }));
    }
# ---------- loginasync: C# additional code ----------
  ResponseAccountLogin myResponse = null;
  string _Email, _Password;
# ---------- end loginasync ----------

# ---- group: WOOT SURPRISE!
c_script = CSharpScript()  # -> out, A
# ---------- c_script: C# ----------
    
    A = this.Component;
    // Mirror mirror on the wall, what is this?
# ---------- end c_script ----------
eo = ExpandObject(Object=c_script.A)  # -> ComponentGuid, ScriptSource, Exposure, InstanceDescription, TooltipText, TooltipDesc, ClippingBox, InConstructor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
eo_2 = ExpandObject(Object=eo.Attributes)  # -> HasInputGrip, HasOutputGrip, ContentBox, PathName, InputGrip, OutputGrip, Pivot, Bounds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
# Showcasing the amazing "ExpandObject" component.
eo_3 = ExpandObject(Object=eo.ScriptSource)  # -> ScriptCode, AdditionalCode, IsEmpty
panel = Panel(eo_3.ScriptCode)

# ----
# Gets a single object from the db. Don't input a list, you'll enter a loop :)
panel_2 = Panel("59cc80ec7056224ff5eb0687")

# ---- group: Get An Object from The Database
getobject = CSharpScript(
    Client=loginasync.ClientOut,
    ObjectId=panel_2,
    Reference=["C:\Users\Dim\AppData\Roaming\Grasshopper\Libraries\SpeckleSendReceive\SpeckleCore.dll", "C:\Users\Dim\AppData\Roaming\Grasshopper\Libraries\SpeckleSendReceive\SpeckleRhinoConverter.dll"])  # -> Response, SpkObject, RhObject; inputs ObjectId: String
# ---------- getobject: C# ----------
    // Get and cast the client
    BaseSpeckleApiClient myClient = Client as BaseSpeckleApiClient;

    // Create a fresh converter if we don't have one
    if(myConverter == null) myConverter = new RhinoConverter();

    // Set outputs
    Response = myResponse;
    SpkObject = myObject;
    if(myObject != null) RhObject = myConverter.ToNative(myObject);

    // Check if we have a new request
    if(ObjectId != _ObjectId)
      Rhino.RhinoApp.MainApplicationWindow.Invoke(new Action(() =>
        {
        _ObjectId = ObjectId;
        
        // Note: Since this is Rhino, we can omit the 'displayValue' field for
        // any objects we get back, as the converter relies on the encoded value.
        myResponse = myClient.ObjectGet("omit=displayValue", ObjectId);
        myObject = myResponse.SpeckleObject;
        this.Component.ExpireSolution(true);
        }));
# ---------- getobject: C# additional code ----------
  RhinoConverter myConverter = null;

  SpeckleObject myObject = null;

  ResponseObjectGet myResponse = null;

  string _ObjectId = null;
# ---------- end getobject ----------

# ----
eo_4 = ExpandObject(Object=getobject.SpkObject)  # -> Type, Base64, Provenance, DisplayValue, DatabaseId, Hash, GeometryHash, ApplicationId, Properties

# ----
# Creates MANY objects in the db.
series = Series(Start=3, Step=1, Count=10)
Z = UnitZ(Factor=series)
polygon = Polygon(Plane=Z, Radius=Slider(4, range=0..10), Segments=6, FilletRadius=0)  # -> Polygon, Length

# ---- group: Save Multiple Objects in the Database
createmanyobjects = CSharpScript(
    Client=loginasync.ClientOut,
    Objs=polygon.Polygon,
    Reference=["C:\Users\Dim\AppData\Roaming\Grasshopper\Libraries\SpeckleSendReceive\SpeckleCore.dll", "C:\Users\Dim\AppData\Roaming\Grasshopper\Libraries\SpeckleSendReceive\SpeckleRhinoConverter.dll"])  # -> Response, SpkObjects; inputs Objs: list of GeometryBase
# ---------- createmanyobjects: C# ----------
    // set output first
    Response = myResponse;
    SpkObjects = myObjects;

    // Get and cast the client
    BaseSpeckleApiClient myClient = Client as BaseSpeckleApiClient;

    // Return if null
    if(myClient == null) return;

    // Create a fresh converter if we don't have one
    if(myConverter == null) myConverter = new RhinoConverter();

    // Exit if no object to send to the db
    if(Objs == null || Objs.Count == 0) return;

    // Convert the object
    myObjects = myConverter.ToSpeckle(Objs).ToList();

    // Calculate a hash for the request
    var bigHash = "";
    myObjects.ForEach(obj => bigHash += obj.Hash);
    var requestHash = CreateMD5(bigHash);

    // Check if we have a new request.
    // Note: this is not a good way of doing it; the grasshopper sender
    // component takes care of this by doing a diff on the list, and implements
    // a cache too, so that previously sent objects do not get sent again.
    if(requestHash != _requestHash) {
      // Create a payload and put in the converted objects
      PayloadMultipleObjects myPayload = new PayloadMultipleObjects() { Objects = myObjects };

      myClient.ObjectCreateBulkAsync(myPayload).ContinueWith(tres =>
        {
        myResponse = tres.Result;

        // Set the database id to the converted objects
        int k = 0;
        myResponse.Objects.ForEach(id =>
          {
          myObjects[k++].DatabaseId = id;
          });

        // Save the request hash
        _requestHash = requestHash;

        this.Component.ExpireSolution(true);
        });
    }
# ---------- createmanyobjects: C# additional code ----------
  RhinoConverter myConverter = null;
  List<SpeckleObject> myObjects = null;
  string _requestHash = "";
  ResponsePostObjects myResponse = null;


  // ref: https://msdn.microsoft.com/en-us/library/system.security.cryptography.md5%28v=vs.110%29.aspx
  public string CreateMD5(string input)
  {
    // Use input string to calculate MD5 hash
    using (System.Security.Cryptography.MD5 md5 = System.Security.Cryptography.MD5.Create())
    {
      byte[] inputBytes = System.Text.Encoding.ASCII.GetBytes(input);
      byte[] hashBytes = md5.ComputeHash(inputBytes);

      // Convert the byte array to hexadecimal string
      System.Text.StringBuilder sb = new System.Text.StringBuilder();
      for (int i = 0; i < hashBytes.Length; i++)
      {
        sb.Append(hashBytes[i].ToString("X2"));
      }
      return sb.ToString();
    }
  }
# ---------- end createmanyobjects ----------

# ----
eo_5 = ExpandObject(Object=createmanyobjects.Response)  # -> Objects, Success, Message
eo_6 = ExpandObject(Object=createmanyobjects.SpkObjects)  # -> Type, Value, DatabaseId, Hash, GeometryHash, ApplicationId, Properties

data = Data(eo_6.DatabaseId)
clean = CleanTree(RemoveNulls=True, RemoveInvalid=True, RemoveEmpty=False, Tree=data)

# ----
# Gets MANY objects from the db. Do input a list :)
panel_3 = Panel(clean)

# ---- group: Get An Object from The Database
getobjects = CSharpScript(
    Client=loginasync.ClientOut,
    ObjectIds=panel_3,
    Reference=["C:\Users\Dim\AppData\Roaming\Grasshopper\Libraries\SpeckleSendReceive\SpeckleCore.dll", "C:\Users\Dim\AppData\Roaming\Grasshopper\Libraries\SpeckleSendReceive\SpeckleRhinoConverter.dll"])  # -> Response, SpkObjects, RhObjects; inputs ObjectIds: list of String
# ---------- getobjects: C# ----------
    // Get and cast the client
    BaseSpeckleApiClient myClient = Client as BaseSpeckleApiClient;

    // Create a fresh converter if we don't have one
    if(myConverter == null) myConverter = new RhinoConverter();

    // Set outputs
    Response = myResponse;
    SpkObjects = myObjects;
    if(myObjects != null) RhObjects = myConverter.ToNative(myObjects);


    PayloadObjectGetBulk myPayload = new PayloadObjectGetBulk() { Objects = ObjectIds };

    // Check if we have a new request: this is a bad way of doing it
    // Quite inelegant, but here's to hacks
    if(_myPayload.ToJson() != myPayload.ToJson()) {
      _myPayload = myPayload;
      myClient.ObjectGetBulkAsync("omit=displayValue", myPayload).ContinueWith(tres =>
        {
        
        myResponse = tres.Result;
        myObjects = myResponse.Objects;
        this.Component.ExpireSolution(true);
        });
    }
# ---------- getobjects: C# additional code ----------
  RhinoConverter myConverter = null;

  List<SpeckleObject> myObjects = null;

  ResponseGetObjects myResponse = null;

  PayloadObjectGetBulk _myPayload = new PayloadObjectGetBulk();
# ---------- end getobjects ----------

# ----
panel_4 = Panel(getobjects.SpkObjects)
eo_7 = ExpandObject(Object=getobjects.Response)  # -> Objects, Success, Message

# ----
# Creates a single object from the db.
sph = Sphere(Base=PlaneXY(0, 0, 0), Radius=1)

# ---- group: Save An Object in The Databse
createobject = CSharpScript(
    Client=loginasync.ClientOut,
    Obj=sph,
    Reference=["C:\Users\Dim\AppData\Roaming\Grasshopper\Libraries\SpeckleSendReceive\SpeckleCore.dll", "C:\Users\Dim\AppData\Roaming\Grasshopper\Libraries\SpeckleSendReceive\SpeckleRhinoConverter.dll"])  # -> Response, SpkObject; inputs Obj: GeometryBase
# ---------- createobject: C# ----------
    // set output first
    Response = myResponse;
    SpkObject = myObject;

    // Get and cast the client
    BaseSpeckleApiClient myClient = Client as BaseSpeckleApiClient;

    // Return if null
    if(myClient == null) return;

    // Create a fresh converter if we don't have one
    if(myConverter == null) myConverter = new RhinoConverter();

    // Exit if no object to send to the db
    if(Obj == null) return;

    // Convert the object
    myObject = myConverter.ToSpeckle(Obj);
    
    // Check if we have a new object
    if(myObject.Hash != _myObject.Hash) {
      Rhino.RhinoApp.MainApplicationWindow.Invoke(new Action(() =>
        {
        // Create a payload and put in the converted object
        PayloadSingleObject myPayload = new PayloadSingleObject() { Object = myObject };
        
        myResponse = myClient.ObjectCreate(myPayload);
        
        // Set the database id to the converted object
        myObject.DatabaseId = myResponse.ObjectId;
        // Save the old object so we can compare upstairs
        _myObject = myObject;

        this.Component.ExpireSolution(true);
        }));
    }
# ---------- createobject: C# additional code ----------
  RhinoConverter myConverter = null;
  SpeckleObject myObject = null;
  ResponsePostObject myResponse = null;
  SpeckleObject _myObject = new SpeckleObject() { Hash = ""};
# ---------- end createobject ----------

# ----
eo_8 = ExpandObject(Object=createobject.SpkObject)  # -> Type, Base64, Provenance, DisplayValue, DatabaseId, Hash, GeometryHash, ApplicationId, Properties
